# Grasshopper definition Hops_multiplication v2.gh (Grasshopper 1.0.7)

get_number = GetNumber(Slider(100, range=1..100), AtLeast=1, AtMost=1, Maximum=1.797693135e+308, Minimum=-1.797693135e+308, TreeAccess=False)
multiplication = Multiplication(A=get_number, B="3")

# ---- group: GH_OUT:num
num = Number(multiplication)

# ----
context_print = ContextPrint(Text=num)
