# Grasshopper definition Hops_multiplication.gh (Grasshopper 1.0.7)

get_number = GetNumber(AtLeast=1, AtMost=1, Maximum=1.797693135e+308, Minimum=-1.797693135e+308, TreeAccess=False)
multiplication = Multiplication(A=get_number, B=Slider(9, range=0..10))
panel = Panel(multiplication)
num = Number(multiplication)
context_print = ContextPrint(Text=num)
